# Grasshopper definition voronoi_corridor.gh (Grasshopper 1.0.8)

number_slider = Slider(25, range=0..100)
brep = Brep(<brep referenced from the Rhino model>)
number_slider_2 = Slider(5, range=0..50)
area = Area(Geometry=brep)  # -> Area, Centroid
popgeo = PopulateGeometry(Geometry=brep, Count=number_slider, Seed=2)
scale = Scale(Geometry=brep, Center=area.Centroid, Factor=2)  # -> Geometry, Transform
popgeo_2 = PopulateGeometry(Geometry=brep, Count=number_slider, Seed=1)
divide = DivideDomain²(Domain=brep, UCount=number_slider_2, VCount=number_slider_2)
voronoi³ = Voronoi3D(Points=popgeo_2, Box=scale.Geometry)  # -> Cells, Boundary
voronoi³_2 = Voronoi3D(Points=popgeo, Box=scale.Geometry)  # -> Cells, Boundary
volume = Volume(Geometry=voronoi³.Cells)  # -> Volume, Centroid
subsrf = Isotrim(Surface=brep, Domain=divide)
scale_2 = Scale(Geometry=voronoi³.Cells, Center=volume.Centroid, Factor=0.8)  # -> Geometry, Transform
trim = TrimSolid(Shape=brep, Cutters=scale_2.Geometry)
item = ListItem(List=trim, Index=0, Wrap=True)
splitmul = SplitBrepMultiple(Brep=item, Cutters=subsrf)
Z = UnitZ(Factor=Slider(-48.45, range=-100..0))
extr = Extrude(Base=splitmul, Direction=Z)
debrep = DeconstructBrep(Brep=splitmul)  # -> Faces, Edges, Vertices
end = EndPoints(Curve=debrep.Edges)  # -> Start, End
ln = Line(StartPoint=end.Start, EndPoint=end.End)
item_2 = ListItem(List=flatten(ln), Index=5, Wrap=True)
linedim = LineDimension(Line=ln, Text="{0:0 mm}", Size=20)
